# Dynamo graph canGetWorksharingModelPath.dyn (Dynamo 2.6.0.7034)

current = Document.Current()
isCloudPath = Document.IsCloudPath(document=current)
getWorksharingPath = Document.GetWorksharingPath(document=current)
