# Dynamo graph canPurgeUnusedElementsFromDocument.dyn (Dynamo 2.6.0.7034)

current = Document.Current()
boolean = BoolSelector(true)
purgeUnused = Document.PurgeUnused(document=current, runRecursively=boolean)
