# Dynamo graph canSaveFamiliesInCurrentDocument.dyn "CanSaveFamiliesInCurrentDocument" (Dynamo 2.6.0.7034)

python_script = Python()
# ---------- python_script.python (14 lines) ----------
# Load the Python Standard and DesignScript Libraries
import sys
import clr
import tempfile
clr.AddReference('ProtoGeometry')
from Autodesk.DesignScript.Geometry import *

# The inputs to this node will be stored as a list in the IN variables.
dataEnteringNode = IN

# Place your code below this line
tempLocation = tempfile.mkdtemp(prefix='test')
# Assign your output to the OUT variable.
OUT = tempLocation
# ----------------------------------------
watch = Watch(python_script)
current = Document.Current()
select_model_elements = DSModelElementsSelection()  # 1 picked in the model
getFamily = FamilyInstance.GetFamily(familyInstance=select_model_elements)
saveFamilyLibrary = Document.SaveFamilyLibrary(document=current, family=getFamily, directoryPath=python_script)
id = Element.Id(element=saveFamilyLibrary)
