# Dynamo graph IsJoined_System_Test.dyn "IsJoined_UnitTest" (Dynamo 2.5.0.5905)

# note: Checking / Outputs
# Orange indicates checking nodes to ensure the script has deployed correctly.

# group: DynamoRevit Test Graph
# note: File Name
# IsJoined_UnitTest.dyn
# note: Version
# Script Version - 001
# Dynamo Version - 2.2.3
# Revit Model - rac_advanced_sample_project.rvt
# Revit Version - 2020
# note: Author
# Sylvester Knudsen
# Computational Specialist
# metaspace.co

# group: Inputs
# note: Variables / Inputs
# Red indicates Variables that can be altered per project and must be set accordingly before running the script.
select_model_element = DSModelElementSelection()  # 1 picked in the model
# note: Working / Functions
# Green indicates the working of the script. No changes should be made in these groups unless advised.
select_model_element_2 = DSModelElementSelection()  # 1 picked in the model

# group: Output
isJoined = Element.IsJoined(element=select_model_element, otherElement=select_model_element_2)
