# Dynamo graph canGetElementTypeByName.dyn (Dynamo 2.6.0.6973)

string = StringInput("24\" x 24\"")
elementTypeByName = Element.ElementTypeByName(name=string)
id = Element.Id(element=elementTypeByName)
string_2 = StringInput("")
elementTypeByName_2 = Element.ElementTypeByName(name=string_2)
id_2 = Element.Id(element=elementTypeByName_2)
