# Dynamo graph setElementsPinStatus.dyn (Dynamo 2.5.0.5905)

select_model_elements = DSModelElementsSelection()  # 2 picked in the model
code_block = CodeBlock { [false,true]; }
setPinnedStatus = Element.SetPinnedStatus(element=select_model_elements, value=code_block)
